# Dynamo graph Color Linked Model.dyn (Dynamo 2.3.0.5885)
# packages: spring nodes 204.1.0, Clockwork for Dynamo 2.x 2.3.0, archi-lab.net 2021.25.19

builtInCategories = Custom[Document.BuiltInCategories]()  # package Clockwork for Dynamo 2.x; List all the available BuiltInCategories
categories = Categories("OST_IOSModelGroups")
ꟿ_collect_allelementsof = Custom[ꟿ Collect.AllElementsOf](CategoryOrType=categories)  # package spring nodes; Works with either categories or types and uses multi-filters to get multiple groups with a single query. Can be applied as a function. No ties to the Document.Changed event.
members = Custom[Group.Members](group=ꟿ_collect_allelementsof)  # package Clockwork for Dynamo 2.x; Retrieves the members of a group
color_palette = ColorPalette({R: 255, G: 1, B: 1, A: 255})
byProperties = Revit.Filter.OverrideGraphicSettings.ByProperties(cutFillColor=color_palette, projectionFillColor=color_palette, cutLineColor=color_palette, projectionLineColor=color_palette)
overrideInView = Element.OverrideInView(element=members, overrides=byProperties)
getDocuments = archilab.Revit.Selection.Select.GetDocuments()
code_block = CodeBlock(x=getDocuments.Link_Instance) { x[6]; }
ꟿ_collect_linkedinstanceelements = Custom[ꟿ Collect.LinkedInstanceElements](linkInstance=code_block)  # package spring nodes; Extract elements by category from the selected linked instances. The transform CS can be used to get the exact location of the elements in the host file. If an error occurs or the linked document is unloaded, an error will be returned in the elements output and the appropriate transform will be a null. You can use those nulls to filter out the errors.; unwired: CategoryOrType
flatten = List.Flatten(list=ꟿ_collect_linkedinstanceelements.elements)
code_block_2 = CodeBlock { 249; }
getItemAtIndex = List.GetItemAtIndex(list=flatten, index=code_block_2)
